% Simulink data dictionary hostData.sldd
% references visionData.sldd

SpheroOut = Simulink.Bus()
  velocity: double
  angle: double

stopspeed = 1
Kp = 0.2
Kd = 0
Ki = 0

ZumoOut = Simulink.Bus()
  motorSpeed: uint8
  TxEnable: double

CommsOut = Simulink.Bus()
  Zumo1: Bus: ZumoOut
  Zumo2: Bus: ZumoOut
  SpheroOrange: Bus: SpheroOut
  SpheroBlue: Bus: SpheroOut

NXTBufferSize = 8

CommsIn = Simulink.Bus()
  NXT: uint8

stopRadius = 25

PositionBus = Simulink.Bus()
  SpheroOrange: double[2]
  SpheroBlue: double[2]
  Zumo1: single[2]
  Zumo2: single[2]

dThresh = 20
restartspeed = 75
tSpheroStop = 10
z1Speed = 20
tOpen = 5
tClose = 6
z2Speed = 20
zumoInitCentroids = single([328 383; 208 148])
posVectOrange = single([155 295.5 415.5; 142 123 233])
posVectBlue = single([102 295.5 395.5; 127 123 213])
hardcodeAngle = 50